# Dynamo graph Создание заданий.dyn (Dynamo 2.16.4.10216)
# packages: DynamoPilot 1.0.0

# group: Массовое создание заданий > Документ к которому добавить задачи
selectDocuments = SelectDocumentsNode()

# group: Массовое создание заданий > Системное имя типа задания
code_block = CodeBlock { "task_simple"; }

# group: Массовое создание заданий > Количество заданий
# Укажите количество заданий
code_block_2 = CodeBlock { 5; }

# group: Массовое создание заданий > Создание списка заголовков
code_block_3 = CodeBlock(a=code_block_2) { b = 100; a+(b-1); 1; "Задача "; }
range = Range(start=code_block_3.b, end=code_block_3.out1, step=code_block_3.out2)
code_block_4 = CodeBlock(a=code_block_3.out3, b=range) { a + b; }

# group: Массовое создание заданий > Добавление строкового атрибута
# Укажите наименование атрибута и список из значений атрибута типа строка для каждой задачи
code_block_5 = CodeBlock(tList=code_block_4) { "title"; tList; }

# group: Массовое создание заданий > Случайные должности
getOrganisationUnits = OrganisationUnit.Get.GetOrganisationUnits()
getIsPosition = OrganisationUnit.Properties.GetIsPosition(pOrganisationUnit=getOrganisationUnits)
filterByBoolMask = List.FilterByBoolMask(list=getOrganisationUnits, mask=getIsPosition)
getId = OrganisationUnit.Properties.GetId(pOrganisationUnit=filterByBoolMask.in)
cycle = List.Cycle(list=getId, amount=code_block_2)
shuffle = List.Shuffle(list=cycle)
takeItems = List.TakeItems(list=shuffle, amount=code_block_2)
flatten = List.Flatten(list=takeItems@L1)

# group: Массовое создание заданий > Должность текущего пользователя
getCurrent = Person.Get.GetCurrent()
getId_2 = Person.Properties.GetId(pPerson=getCurrent)
person = OrganisationUnit.Properties.Person(pOrganisationUnit=filterByBoolMask.in)
eq = getId_2 == person
filterByBoolMask_2 = List.FilterByBoolMask(list=filterByBoolMask.in, mask=eq)
getId_3 = OrganisationUnit.Properties.GetId(pOrganisationUnit=filterByBoolMask_2.in)

# group: Массовое создание заданий > Атрибут типа Орг.единица
# Получите ID должности инициатора и впишите номер
code_block_6 = CodeBlock(a=getId_3) { "initiator"; [a[0]]; }

# group: Массовое создание заданий
getTypeByName = Type.Get.GetTypeByName(name=code_block)
ofRepeatedItem = List.OfRepeatedItem(item=code_block_6.out1, amount=code_block_2)

# group: Массовое создание заданий > Атрибут типа Орг.единица
# Получите ID должности исполнителя и впишите номер
code_block_7 = CodeBlock(rList=flatten) { "executor"; [rList]; }

# group: Массовое создание заданий > Атрибут типа Дата и время
# Введите наименования атрибута "Дата выдачи"
code_block_8 = CodeBlock { "dateOfAssignment"; }
now = DateTime.Now()

# group: Массовое создание заданий > Создание случайных дат
now_2 = DateTime.Now()
code_block_9 = CodeBlock(count=code_block_2)
# ---------- code_block_9.designscript (6 lines) ----------
count;
List.TakeItems(List.Shuffle(List.Cycle(0..364,count)),count);
List.TakeItems(List.Shuffle(List.Cycle(0..23,count)),count);
List.TakeItems(List.Shuffle(List.Cycle(0..59,count)),count);
List.TakeItems(List.Shuffle(List.Cycle(0..59,count)),count);
List.TakeItems(List.Shuffle(List.Cycle(0..999,count)),count);
# ----------------------------------------
create = TimeSpan.Create(days=code_block_9.out1, hours=code_block_9.out2, minutes=code_block_9.out3, seconds=code_block_9.out4, milliseconds=code_block_9.out5)
addTimeSpan = DateTime.AddTimeSpan(dateTime=now_2, timeSpan=create)

# group: Массовое создание заданий > Атрибут типа Дата и время
# Введите наименования атрибута "Срок до" и значение в формате мм.дд.гггг
code_block_10 = CodeBlock(rDateList=addTimeSpan) { "deadlineDate"; rDateList; }

# group: Массовое создание заданий > Получение всех существующих статусов в БД
# Получаем все существующие статусы и выбираем нужные
getAll = UserState.Get.GetAll()

# group: Массовое создание заданий > Получение конкретного статуса
getName = UserState.Properties.GetName(pUserState=getAll)
code_block_11 = CodeBlock { "assigned"; }
eq_2 = getName == code_block_11
filterByBoolMask_3 = List.FilterByBoolMask(list=getAll, mask=eq_2)
code_block_12 = CodeBlock(a=filterByBoolMask_3.in) { a[0]; }

# group: Массовое создание заданий > Атрибут типа Состояние
# Укажите индекты статусов для задания и наименование атрибута типа состояние из myAdmin
code_block_13 = CodeBlock { "state"; }
getId_4 = UserState.Properties.GetId(pUserState=code_block_12)

# group: Массовое создание заданий > Генерируем словарь атрибутров
byKeysValues = DesignScript.Builtin.Dictionary.ByKeysValues(keys=code_block_5.out0, values=code_block_5.tList@L1)
setValueAtKeys = DesignScript.Builtin.Dictionary.SetValueAtKeys(dictionary=byKeysValues, keys=code_block_6.out0, values=ofRepeatedItem)
setValueAtKeys_2 = DesignScript.Builtin.Dictionary.SetValueAtKeys(dictionary=setValueAtKeys, keys=code_block_7.out0, values=code_block_7.out1, lacing=Longest)
setValueAtKeys_3 = DesignScript.Builtin.Dictionary.SetValueAtKeys(dictionary=setValueAtKeys_2, keys=code_block_8, values=now, lacing=Longest)
setValueAtKeys_4 = DesignScript.Builtin.Dictionary.SetValueAtKeys(dictionary=setValueAtKeys_3, keys=code_block_10.out0, values=code_block_10.rDateList, lacing=Longest)
setValueAtKeys_5 = DesignScript.Builtin.Dictionary.SetValueAtKeys(dictionary=setValueAtKeys_4, keys=code_block_13, values=getId_4)

# group: Массовое создание заданий > Создание заданий в БД с предустановленными значениями атрибутов
code_block_14 = CodeBlock { "00000000-0000-0000-0000-000000000000"; }
createByStrParentIdWithAttributes = DataObject.Create.CreateByStrParentIdWithAttributes(parentId=code_block_14, type=getTypeByName, attributes=setValueAtKeys_5, lacing=Longest)

# group (continued): Массовое создание заданий
getId_5 = DataObject.Properties.GetId(dataObject=createByStrParentIdWithAttributes)

# group: Массовое создание заданий > Добавление связей Документы - Задания
getId_6 = DataObject.Properties.GetId(dataObject=selectDocuments)
code_block_15 = CodeBlock { null; }
objectRelationType = ObjectRelationTypeDropdown("TaskAttachments")
addRelation = DataObject.Edit.Relation.AddRelation(objectId=getId_6, name=code_block_15, type=objectRelationType, targetId=getId_5, lacing=Longest)
